# Dynamo graph hyperbolic-paraboloid.dyn "hyperbolic-paraboloid-v3" (Dynamo 2.1.0.7500)

# group: Hyperbolic Paraboloid
origin = Point.Origin()
count_slider = IntegerSlider(8, range=2..25 step 1)
height_modifier_slider = DoubleSlider(0.7, range=0..1 step 0.1)
code_block = CodeBlock(count=count_slider, height=height_modifier_slider) { [0, count]; [0, count * height]; [0, count]; count; [count * height, 0]; 0..1..(1/count); }
translate = Geometry.Translate(geometry=origin, xTranslation=code_block.out0, zTranslation=code_block.out1)
translate_2 = Geometry.Translate(geometry=origin, xTranslation=code_block.out2, yTranslation=code_block.count, zTranslation=code_block.out4)
byStartPointEndPoint = Line.ByStartPointEndPoint(startPoint=translate, endPoint=translate_2)
byLoft = Surface.ByLoft(crossSections=byStartPointEndPoint)
